# Grasshopper definition AugmentedBim.gh (Grasshopper 0.9.76)
# plug-ins: Spectacles.GrasshopperExporter

swatch = ColourSwatch(SwatchColor=RGB(0, 42, 255))
swatch_2 = ColourSwatch(SwatchColor=RGB(255, 0, 0))
geo = Geometry([<brep referenced from the Rhino model> x2])
spectacles_meshlambertmaterial = Spectacles_MeshLambertMaterial(
    Color=[swatch, swatch_2],
    AmbientColor=[swatch, swatch_2],
    EmissiveColor=RGB(0, 0, 0),
    Object_Opacity=Slider(1, range=0..1),
    SmoothEdges=Toggle(False))
mesh = MeshBrep(
    Brep=geo,
    Settings={GridMaxCount=0, GridMinCount=16, JaggedSeams=False, MaxEdgeLength=0, MinEdgeLength=0.0001, MinTolerance=0, Refine=True, RefineAngle=0, RelativeTolerance=0.65, SimplePlanes=True, Tolerance=0})
preview = CustomPreview(Geometry=mesh, Shader=[swatch, swatch_2])
panel = Panel("""color
color""")
panel_2 = Panel("""blue
red""")
panel_3 = Panel("C:\Users\agarciapuyol\Documents\GitHub\AugmentedBIM\content\box.json")
spectacles_mesh = Spectacles_Mesh(
    Mesh=graft(mesh),
    MeshMaterial=graft(spectacles_meshlambertmaterial),
    AttributeNames=graft(panel),
    AttributeValues=graft(panel_2))
spectacles_scenecompiler = Spectacles_SceneCompiler(Write=Button(), FilePath=panel_3, Elements=flatten(spectacles_mesh))
